# Dynamo graph 05_Write-CA-Legend.dyn (Dynamo 2.16.2.5624)

python_script = Python()  # CPython3
# ---------- python_script.python (17 lines) ----------
import clr
clr.AddReference("RevitAPI")
clr.AddReference("RevitServices")
from Autodesk.Revit.DB import *
from RevitServices.Persistence import DocumentManager

# Get the active document
doc = DocumentManager.Instance.CurrentDBDocument

# Get all views
collector = FilteredElementCollector(doc).OfClass(View)

# Filter only Legend Views
legend_views = [view for view in collector if view.ViewType == ViewType.Legend]

# Output the list of legend views
OUT = legend_views
# ----------------------------------------
watch = Watch(python_script)

# group: Current Project
current = Document.Current()
filePath = Document.FilePath(document=current)

# group: Return the Folder of the Current Project
code_block = CodeBlock { "\\"; }
code_block_2 = CodeBlock { "\\"; }
split = String.Split(string=filePath, separator0=code_block_2)
code_block_3 = CodeBlock { -1; }
dropItems = List.DropItems(list=split, amount=code_block_3)
join = String.Join(separator=code_block, string0=dropItems)

# group: Master Check Template Location
file_path = Filename("Templates\02_Master-Check.xlsx")
file_from_path = FileObject(path=file_path)
string_from_object = FromObject(object=file_from_path)

# group: Return the File Name of the Master Check Template
code_block_4 = CodeBlock { "\\"; }
code_block_5 = CodeBlock { "\\"; }
split_2 = String.Split(string=string_from_object, separator0=code_block_5)
lastItem = List.LastItem(list=split_2)
join_2 = String.Join(separator=code_block_4, string0=lastItem)

# group: Combine Into the Current Project Path and Template Name for Master Check
code_block_6 = CodeBlock { "\\"; }
combinePath = FileSystem.CombinePath(string0=join, string1=join_2)
join_3 = String.Join(separator=code_block_6, string0=combinePath)

# group: Read from Takeoff Excel
file_from_path_2 = FileObject(path=join_3)
string = StringInput("RevitExtraction")
boolean = BoolSelector(true)
importExcel = Data.ImportExcel(file=file_from_path_2, sheetName=string, showExcel=boolean)

watch_2 = Watch(importExcel)
code_block_7 = CodeBlock { "DSP Comp Ref"; }
python_script_2 = Python(IN[0]=code_block_7)  # CPython3
# ---------- python_script_2.python (43 lines) ----------
import clr
clr.AddReference("RevitAPI")
clr.AddReference("RevitServices")
from Autodesk.Revit.DB import *
from RevitServices.Persistence import DocumentManager

# Inputs
doc = DocumentManager.Instance.CurrentDBDocument

# Debugging step: check if input exists and its type
if len(IN) < 1:
    OUT = "Error: Input list is empty. Please provide an input string for the legend name."
    raise SystemExit

# Attempt to retrieve the legend name, and handle if it fails
try:
    legend_name = IN[0]
    # Debugging: print input type and content to see what is being received
    OUT = f"Input received: Type = {type(legend_name)}, Content = {legend_name}"
except IndexError:
    OUT = "Error: Unable to read input from IN[0]. Please verify the input connection."
    raise SystemExit

# Ensure the input is of the correct type (str)
if not isinstance(legend_name, str):
    OUT = f"Error: Input must be a string, received type {type(legend_name)}. Please use a string node."
    raise SystemExit

# Get all views in the document
collector = FilteredElementCollector(doc).OfClass(View)

# Filter only Legend Views with the specified name
specific_legend = None
for view in collector:
    if view.ViewType == ViewType.Legend and view.Name.strip() == legend_name.strip():
        specific_legend = view
        break

# Check if the legend was found and output the result
if specific_legend is None:
    OUT = f"Legend with name '{legend_name}' not found."
else:
    OUT = specific_legend
# ----------------------------------------
code_block_8 = CodeBlock { "PRODUCE"; }
python_script_3 = Python(IN[0]=python_script_2, IN[1]=code_block_8)  # CPython3
# ---------- python_script_3.python (78 lines) ----------
import clr
clr.AddReference("RevitAPI")
clr.AddReference("RevitServices")
from Autodesk.Revit.DB import *
from RevitServices.Persistence import DocumentManager
from collections import defaultdict
import re

# Inputs
doc = DocumentManager.Instance.CurrentDBDocument
legend_view = UnwrapElement(IN[0])  # Legend View input
target_row_start_text = IN[1]  # The text of the main category to extract (e.g., "FROZEN FOOD")

# Collect all TextNote elements in the Legend View
collector = FilteredElementCollector(doc, legend_view.Id).OfClass(TextNote)
text_notes = []

for text_note in collector:
    location = text_note.Coord  # XYZ location of the Text Note
    element_data = {
        "ElementId": text_note.Id.IntegerValue,
        "Text": text_note.Text,
        "Location": location
    }
    text_notes.append(element_data)

# Preprocess the target text to remove extra whitespace and normalize line breaks
target_row_start_text_clean = re.sub(r'\s+', ' ', target_row_start_text.strip()).upper()

# Group text notes by rows (based on Y-coordinate)
tolerance = 0.1  # Increased tolerance for determining whether two text notes are in the same row
rows = defaultdict(list)

for text_note in text_notes:
    y_coord = text_note["Location"].Y
    found_row = False
    for key in rows.keys():
        if abs(y_coord - key) < tolerance:
            rows[key].append(text_note)
            found_row = True
            break
    if not found_row:
        rows[y_coord].append(text_note)

# Sort rows by Y-coordinate (descending order for top to bottom)
sorted_rows = sorted(rows.items(), key=lambda x: -x[0])

# Sort elements within each row by X-coordinate (ascending order for left to right)
sorted_rows_data = []
for y_value, elements in sorted_rows:
    sorted_elements = sorted(elements, key=lambda e: e["Location"].X)
    sorted_rows_data.append(sorted_elements)

# Find the row that starts with the target_row_start_text and capture all related rows
target_rows_data = []
capture = False

for row in sorted_rows_data:
    # Clean up the text of each element in the row
    for element in row:
        element_text_clean = re.sub(r'\s+', ' ', element["Text"].strip()).upper()
        # If we find the target row, start capturing rows
        if element_text_clean == target_row_start_text_clean:
            capture = True

    # Capture the row if we are in the target section
    if capture:
        target_rows_data.append(row)

    # Stop capturing if a new major heading is found (excluding current target)
    # You can modify this condition based on how headings are defined in your table
    if capture and len(row) > 0:
        first_text = re.sub(r'\s+', ' ', row[0]["Text"].strip()).upper()
        if first_text != target_row_start_text_clean and first_text.isupper() and len(first_text.split()) == 1:
            break

# Output all the rows starting with and under the target_row_start_text
OUT = target_rows_data
# ----------------------------------------
watch_3 = Watch(python_script_3)
code_block_9 = CodeBlock { "DAIRY"; }
python_script_4 = Python(IN[0]=python_script_2, IN[1]=code_block_9)  # CPython3; same code as python_script_3
watch_4 = Watch(python_script_4)
code_block_10 = CodeBlock { "SEAFOOD & MEAT"; }
python_script_5 = Python(IN[0]=python_script_2, IN[1]=code_block_10)  # CPython3; same code as python_script_3
watch_5 = Watch(python_script_5)
code_block_11 = CodeBlock { "TAB"; }
python_script_6 = Python(IN[0]=python_script_2, IN[1]=code_block_11)  # CPython3; same code as python_script_3
watch_6 = Watch(python_script_6)
code_block_12 = CodeBlock { "FROZEN FOOD"; }
python_script_7 = Python(IN[0]=python_script_2, IN[1]=code_block_12)  # CPython3; same code as python_script_3
watch_7 = Watch(python_script_7)
code_block_13 = CodeBlock { "SHELVING"; }
python_script_8 = Python(IN[0]=python_script_2, IN[1]=code_block_13)  # CPython3; same code as python_script_3
watch_8 = Watch(python_script_8)
